# Grasshopper definition AttractorsLunchbox.gh (Grasshopper 1.0.7)
# plug-ins: LunchBox

crv = Curve(<curve referenced from the Rhino model>)
crv_2 = Curve(<curve referenced from the Rhino model>)
sqgrid = Square(Plane=crv, Size=Slider(16, range=0..100), ExtentX=5, ExtentY=Slider(23, range=0..100))  # -> Cells, Points
number_slider = Slider(2, range=0..10)
sqgrid_2 = Square(Plane=crv_2, Size=Slider(16, range=0..100), ExtentX=5, ExtentY=Slider(23, range=0..100))  # -> Cells, Points
crv_3 = Curve(<curve referenced from the Rhino model>)
crv_4 = Curve(<curve referenced from the Rhino model>)
pt = Point(Point(747.2528711, -1061.15362, 0))
area = Area(Geometry=sqgrid.Cells)  # -> Area, Centroid
divide = DivideCurve(Curve=crv_3, Count=10, Kinks=False)  # -> Points, Tangents, Parameters
area_2 = Area(Geometry=sqgrid_2.Cells)  # -> Area, Centroid
divide_2 = DivideCurve(Curve=crv_4, Count=10, Kinks=False)  # -> Points, Tangents, Parameters
attract = Attractor(AttractorPoints=divide_2.Points, TargetPoints=area_2.Centroid, AttractorDomain="{2;5}")  # -> Values, Vectors, Distances
attwave = AttractorWave(AttractorPoints=divide.Points, TargetPoints=area.Centroid, AttractorDomain="{2;5}", Frequency=Slider(0.1, range=0..1))  # -> Values, Vectors, Distances
cir = Circle(Plane=area_2.Centroid, Radius=attract.Values)
attract_2 = Attractor(AttractorPoints=pt, TargetPoints=area.Centroid, AttractorDomain="{1;15}")  # -> Values, Vectors, Distances
group = Group(Objects=flatten(cir))
polygon = Polygon(Plane=area.Centroid, Radius=attwave.Values, Segments=3, FilletRadius=0)  # -> Polygon, Length
cir_2 = Circle(Plane=area.Centroid, Radius=attwave.Values)
rotate = Rotate(Geometry=polygon.Polygon, Angle=attract_2.Values, Plane=area.Centroid)  # -> Geometry, Transform
group_2 = Group(Objects=flatten(rotate.Geometry))
