# Grasshopper definition CityFinalGenerator.gh (Grasshopper 1.0.7)

number_of_creases = Slider(10, range=3..20)
depth_of_crease = Slider(8, range=0..8)
rotation = Slider(0, range=0..90)
height = Slider(7, range=2..15)
pt = ConstructPoint(XCoordinate=0, YCoordinate=0, ZCoordinate=0)
neg = Negative(Value=depth_of_crease)
circle = CircleCNR(Center=pt, Normal=Vector(0, 0, 1), Radius=Slider(19, range=14..25))
destance_b_layers = Slider(10, range=0..100)
divide = DivideCurve(Curve=circle, Count=number_of_creases, Kinks=False)  # -> Points, Tangents, Parameters
series = Series(Start=Slider(0, range=0..0.1), Step=0.1, Count=height)
graph = GraphMapper(
    series,
    x0=0,
    x1=1,
    y0=0,
    y1=1,
    container_name="Bezier",
    cpx=[0, 0.2987767756, 0.4022902846, 1],
    cpy=[0.7542835474, 0.2708411813, 0.9026385546, 0.3304752707])
dispatch = Dispatch(List=divide.Points, DispatchPattern=[True, False])  # -> ListA, ListB
vec2pt = Vector2Pt(PointA=pt, PointB=dispatch.ListB, Unitize=False)  # -> Vector, Length
series_2 = Series(Start=0, Step=destance_b_layers, Count=height)
amp = Amplitude(Vector=vec2pt.Vector, Amplitude=neg)
pt_2 = Point(dispatch.ListA)
move = Move(Geometry=dispatch.ListB, Motion=amp)  # -> Geometry, Transform
weave = Weave(Pattern=[0, 1], Stream0=pt_2, Stream1=move.Geometry, NullGaps=False)
intcrv = Interpolate(Vertices=weave, Degree=3, Periodic=True, KnotStyle=1)  # -> Curve, Length, Domain
Z = UnitZ(Factor=series_2)
series_3 = Series(Start=0, Step=rotation, Count=height)
move_2 = Move(Geometry=intcrv.Curve, Motion=Z)  # -> Geometry, Transform
area = Area(Geometry=move_2.Geometry)  # -> Area, Centroid
scale = Scale(Geometry=move_2.Geometry, Center=area.Centroid, Factor=graph)  # -> Geometry, Transform
rad = Radians(Degrees=series_3)
rotate = Rotate(Geometry=scale.Geometry, Angle=rad, Plane=PlaneXY(0, 0, 0))  # -> Geometry, Transform
loft = Loft(Curves=rotate.Geometry, Options={Adjust=False, Closed=False, LoftEnds=0, LoftSimp=0, LoftType=0, Rebuild=10, Refit=0.01})

# ----
# Windows Generator
geo = Geometry(loft)
dam = DataDam(DataA=geo, BufferDelay=10000000, BufferMode=0)
number_slider = Slider(218, range=0..1000)
sdivide = DivideSurface(Surface=reparameterize(dam), UCount=number_slider, VCount=Slider(235, range=0..1000))  # -> Points, Normals, Parameters
image = ImageSampler(sdivide.Parameters, Filter="Value", Interpolate=True, Umax=1, Umin=0, Vmax=1, Vmin=0, Wrap=1)
multiplication = Multiplication(A=image, B=Slider(-0.5, range=-100..100))
amp_2 = Amplitude(Vector=sdivide.Normals, Amplitude=multiplication)
move_3 = Move(Geometry=sdivide.Points, Motion=amp_2)  # -> simplify(flatten(Geometry)), Transform
dam_2 = DataDam(DataA=move_3.Geometry, BufferDelay=10000000, BufferMode=0)
srfgrid = SurfaceFromPoints(Points=dam_2, UCount=expr("x+1", number_slider), Interpolate=False)
preview = CustomPreview(Geometry=srfgrid, Material=ColourSwatch(SwatchColor=RGB(242, 124, 195)))

cap = CapHoles(Brep=loft)
preview_2 = CustomPreview(Geometry=cap, Material=ColourSwatch(SwatchColor=RGB(154, 49, 224)))
munion = MeshUnion()
