# Grasshopper definition G-code_slicer.gh (Grasshopper 1.0.7)

crv = Curve(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)

cp = ControlPoints(Curve=crv)  # -> Points, Weights, Knots
explode = Explode(Curve=crv, Recursive=True)  # -> Segments, Vertices
len = Length(Curve=explode.Segments)
panel = Panel(cp.Points)
ins = InsertItems(List=len, Item="0", Indices="0", Wrap=True)
ma = MassAddition(Input=flatten(ins))  # -> Result, PartialResults
pdecon = Deconstruct(Point=flatten(panel))  # -> XComponent, YComponent, ZComponent
multiplication = Multiplication(A="20", B="60")
panel_2 = Panel(ma.PartialResults)
multiplication_2 = Multiplication(A=panel_2)
concat = Concatenate(
    FragmentA="G1",
    FragmentB=" F",
    FragmentC=multiplication,
    FragmentD=" X",
    FragmentE=pdecon.XComponent,
    FragmentF=" Y",
    FragmentG=pdecon.YComponent,
    FragmentH=" Z",
    FragmentI=pdecon.ZComponent,
    FragmentJ=" E",
    FragmentK=multiplication_2)
um2_start = Panel("""M73 P0 R90
M73 Q0 S91
M201 X1000 Y1000 Z200 E5000 ; sets maximum accelerations, mm/sec^2
M203 X200 Y200 Z12 E120 ; sets maximum feedrates, mm/sec
M204 P1250 R1250 T1250 ; sets acceleration (P, T) and retract acceleration (R), mm/sec^2
M205 X8.00 Y8.00 Z0.40 E1.50 ; sets the jerk limits, mm/sec
M205 S0 T0 ; sets the minimum extruding and travel feed rate, mm/sec
M107
M115 U3.10.0 ; tell printer latest fw version
G90 ; use absolute coordinates
M83 ; extruder relative mode
M104 S230 ; set extruder temp
M140 S85 ; set bed temp
M190 S85 ; wait for bed temp
M109 S230 ; wait for extruder temp
G28 W ; home all without mesh bed level
G80 ; mesh bed leveling
G1 Y-3.0 F1000.0 ; go outside print area
G92 E0.0
G1 X60.0 E9.0 F1000.0 ; intro line
M73 Q0 S91
M73 P0 R90
G1 X100.0 E12.5 F1000.0 ; intro line
G92 E0.0
M221 S95
M900 K45 ; Filament gcode
G21 ; set units to millimeters
G90 ; use absolute coordinates
M83 ; use relative distances for extrusion
;BEFORE_LAYER_CHANGE
G92 E0.0
;0.2

G1 E-0.80000 F2100.00000
G1 Z0.600 F10800.000
;AFTER_LAYER_CHANGE
;0.2
G1 X119.972 Y99.661
G1 Z0.200
G1 E0.80000 F2100.00000
M204 S1000""")
um2_end = Panel("""M204 S1000
G1 X124.749 Y104.588 F10800.000
G1 F8640;_WIPE
G1 X124.739 Y104.536 E-0.02919
G1 F8640;_WIPE
G1 X124.935 Y104.476 E-0.04715
G1 F8640;_WIPE
G1 X125.128 Y104.471 E-0.04474
G1 F8640;_WIPE
G1 X125.220 Y104.498 E-0.02200
G1 F8640;_WIPE
G1 X125.306 Y104.553 E-0.02370
G1 F8640;_WIPE
G1 X125.334 Y104.617 E-0.01596
G1 F8640;_WIPE
G1 X125.350 Y104.767 E-0.03489
G1 F8640;_WIPE
G1 X125.323 Y104.918 E-0.03536
G1 F8640;_WIPE
G1 X125.232 Y105.100 E-0.04712
G1 F8640;_WIPE
G1 X125.184 Y105.152 E-0.01619
G1 F8640;_WIPE
G1 X125.082 Y105.208 E-0.02705
G1 F8640;_WIPE
G1 X124.969 Y105.195 E-0.02604
G1 F8640;_WIPE
G1 X124.902 Y105.166 E-0.01697
G1 F8640;_WIPE
G1 X124.745 Y105.032 E-0.04759
G1 F8640;_WIPE
G1 X124.609 Y104.827 E-0.05675
G1 F8640;_WIPE
G1 X124.609 Y104.665 E-0.03751
G1 F8640;_WIPE
G1 X124.645 Y104.620 E-0.01327
G1 E-0.25852 F2100.00000
G1 Z70.850 F10800.000
M107
; Filament-specific end gcode
G4 ; wait
M221 S100
M104 S0 ; turn off temperature
M140 S0 ; turn off heatbed
M107 ; turn off fan
G1 Z100.85 ; Move print head up
G1 X0 Y200 F3000 ; home X axis
M84 ; disable motors
M73 P100 R0
M73 Q100 S0""")
merge = Merge(Data1=um2_start, Data2=concat, Data3=um2_end)
panel_3 = Panel(merge)
