# Grasshopper definition GA_3dprint_toy.gh (Grasshopper 1.0.4)
# plug-ins: Octopus

# GA 3D printable geometry
genes = GenePool(Decimals=2, Maximum=100, Minimum=0, Value=[50.29086428, 85.22366435])
pt = ConstructPoint(XCoordinate=0, YCoordinate=0, ZCoordinate=0)
item = ListItem(List=genes, Index=0, Wrap=True)
item_2 = ListItem(List=genes, Index=0, Wrap=True)  # -> Item, Item1
X = UnitX(Factor=item)
Y = UnitY(Factor=item_2.Item1)
move = Move(Geometry=pt, Motion=X)  # -> Geometry, Transform
move_2 = Move(Geometry=move.Geometry, Motion=Y)  # -> Geometry, Transform

pt_2 = ConstructPoint(XCoordinate=0, YCoordinate=Slider(44, range=0..80), ZCoordinate=0)
pt_3 = ConstructPoint(XCoordinate=0, YCoordinate=0, ZCoordinate=0)
ln = Line(StartPoint=pt_3, EndPoint=move_2.Geometry)
ln_2 = Line(StartPoint=move_2.Geometry, EndPoint=pt_2)

octopus = Octopus(OctopusData_gene=genes, OctopusData_obj=num)
polar = ToPolar(Point=move_2.Geometry, System=PlaneXY(0, 0, 0))  # -> Phi, Theta, Radius
deg = Degrees(Radians=polar.Phi)
panel = Panel(deg)
merge = Merge(Data1=ln, Data2=ln_2)
subtraction = Subtraction(A="60", B=deg)
xz = XZPlane(Origin=Point(0, 0, 0))
abs = Absolute(Value=subtraction)
arrpolar = PolarArray(Geometry=merge, Plane=xz, Count=10, Angle=6.283185307)  # -> Geometry, Transform
num = Number(abs)
panel_2 = Panel(num)
