# Grasshopper definition ImageVase.gh (Grasshopper 1.0.4)

height = Slider(8, range=0..100)
destance_b_layers = Slider(29, range=0..100)
# Vase Shape
number_slider = Slider(63, range=0..100)
number_of_creases = Slider(13, range=0..100)
depth_of_crease = Slider(0, range=0..100)
rotation = Slider(0, range=0..1000)
pt = ConstructPoint(XCoordinate=0, YCoordinate=0, ZCoordinate=0)
circle = CircleCNR(Center=pt, Normal=Vector(0, 0, 1), Radius=number_slider)
divide = DivideCurve(Curve=circle, Count=number_of_creases, Kinks=False)  # -> Points, Tangents, Parameters
dispatch = Dispatch(List=divide.Points, DispatchPattern=[True, False])  # -> ListA, ListB
vec2pt = Vector2Pt(PointA=pt, PointB=dispatch.ListB, Unitize=False)  # -> Vector, Length
neg = Negative(Value=depth_of_crease)
amp = Amplitude(Vector=vec2pt.Vector, Amplitude=neg)
pt_2 = Point(dispatch.ListA)
move = Move(Geometry=dispatch.ListB, Motion=amp)  # -> Geometry, Transform
weave = Weave(Pattern=[0, 1], Stream0=pt_2, Stream1=move.Geometry, NullGaps=False)
intcrv = Interpolate(Vertices=weave, Degree=3, Periodic=True, KnotStyle=1)  # -> Curve, Length, Domain
series = Series(Start=0, Step=destance_b_layers, Count=height)
Z = UnitZ(Factor=series)
move_2 = Move(Geometry=intcrv.Curve, Motion=Z)  # -> Geometry, Transform
series_2 = Series(Start=Slider(0, range=0..0.1), Step=0.1, Count=height)
# Shape
graph = GraphMapper(
    series_2,
    x0=0,
    x1=1,
    y0=0,
    y1=1,
    container_name="Bezier",
    cpx=[0, 0.1364090741, 1, 1],
    cpy=[0.5265343189, 0.7290613651, 0.9898917079, 0.3546931148])
area = Area(Geometry=move_2.Geometry)  # -> Area, Centroid
panel = Panel(area.Centroid)
scale = Scale(Geometry=move_2.Geometry, Center=area.Centroid, Factor=graph)  # -> Geometry, Transform
panel_2 = Panel(graph)
series_3 = Series(Start=0, Step=rotation, Count=height)
rad = Radians(Degrees=series_3)
rotate = Rotate(Geometry=scale.Geometry, Angle=rad, Plane=PlaneXY(0, 0, 0))  # -> Geometry, Transform
loft = Loft(Curves=rotate.Geometry, Options={Adjust=False, Closed=False, LoftEnds=0, LoftSimp=0, LoftType=0, Rebuild=10, Refit=0.01})

# ----
# Pattern
# Number of points in U and V directions.
# aka Resolution
number_slider_2 = Slider(218, range=0..1000)
geo = Geometry(loft)
sdivide = DivideSurface(Surface=reparameterize(geo), UCount=number_slider_2, VCount=Slider(235, range=0..1000))  # -> Points, Normals, Parameters
image = ImageSampler(
    sdivide.Parameters,
    FilePath="C:\Users\FabVR-0\Downloads\Art2.png",
    Filter="Value",
    Interpolate=True,
    Umax=1,
    Umin=0,
    Vmax=1,
    Vmin=0,
    Wrap=1)
multiplication = Multiplication(A=image, B=Slider(-8, range=-100..100))
amp_2 = Amplitude(Vector=sdivide.Normals, Amplitude=multiplication)
move_3 = Move(Geometry=sdivide.Points, Motion=amp_2)  # -> simplify(flatten(Geometry)), Transform
dam = DataDam(DataA=move_3.Geometry, BufferDelay=10000000, BufferMode=0)
srfgrid = SurfaceFromPoints(Points=dam, UCount=expr("x+1", number_slider_2), Interpolate=False)
preview = CustomPreview(Geometry=srfgrid, Material=ColourSwatch(SwatchColor=RGB(242, 124, 195)))

preview_2 = CustomPreview(Geometry=loft, Material=ColourSwatch(SwatchColor=RGB(255, 130, 203)))
