# Grasshopper definition RotateSculture.gh (Grasshopper 1.0.7)

trigger = Trigger(Interval=10, TimerInterval=10, Target=python)
mesh = Mesh(<mesh referenced from the Rhino model>)
volume = Volume(Geometry=mesh)  # -> Volume, Centroid
python = GhPythonScript(state=Toggle(False), limY=Slider(360, range=0..1000))  # -> out, b; inputs state: Boolean
# ---------- python: Python ----------
from scriptcontext import sticky


if not state:
    sticky["valY"] = 0
else:
    sticky["valY"] += 0.1
    if sticky["valY"] >= limY:
        sticky["valY"] = 0

b = sticky["valY"]
# ---------- end python ----------
rotate = Rotate(Geometry=mesh, Angle=python.b, Plane=volume.Centroid)  # -> Geometry, Transform
panel = Panel(python.b)
preview = CustomPreview(Geometry=rotate.Geometry, Material=ColourSwatch(SwatchColor=RGB(255, 255, 255)))
