# Grasshopper definition Toy_bottomless.gh (Grasshopper 1.0.7)
# plug-ins: Kangaroo2 Components

series = Series(Start=Slider(0.5, range=0..1), Step=Slider(0.8, range=0..1), Count=Slider(16, range=0..170))

number_slider = Slider(4, range=0..10)
range = Range(Domain=Domain(0, 1), Steps=number_slider)
graph = GraphMapper(
    range,
    x0=0,
    x1=1,
    y0=0,
    y1=1,
    Ox=0.5017413497,
    Oy=0.9287018776,
    Px=0.9577242136,
    Py=0.006555616856,
    container_name="Parabola")
area = Slider(15.6, range=0..100)
line = LineSDL(Start=Point(0, 0, 0), Direction=Vector(0, 0, 1), Length=Slider(50, range=0..100))
divide = DivideCurve(Curve=line, Count=number_slider, Kinks=False)  # -> Points, Tangents, Parameters
multiplication = Multiplication(A=area, B=graph)
series_2 = Series(Start=0, Step=Slider(35, range=0..40), Count=number_slider)
number_slider_2 = Slider(3, range=0..30)
cir = Circle(Plane=divide.Points, Radius=multiplication)
rotate = Rotate(Geometry=cir, Angle=degrees(series_2), Plane=PlaneXY(0, 0, 0))  # -> Geometry, Transform
divide_2 = DivideCurve(Curve=rotate.Geometry, Count=number_slider, Kinks=False)  # -> simplify(Points), Tangents, Parameters
flip = FlipMatrix(Data=divide_2.Points)
item = ListItem(List=flatten(flip), Index=number_slider, Wrap=True)
replace = ReplaceItems(List=flip, Item="{0,0,0}", Indices="0", Wrap=False)
pdecon = Deconstruct(Point=item)  # -> XComponent, YComponent, ZComponent
expression = Expression(z=pdecon.ZComponent, Expression="{0, 0, z}")
replace_2 = ReplaceItems(List=replace, Item=expression, Indices=number_slider, Wrap=False)
intcrv = Interpolate(Vertices=replace_2, Degree=3, Periodic=False, KnotStyle=1)  # -> Curve, Length, Domain
number_slider_3 = Slider(1.8, range=0..10)
mp = MultiPipe(
    Curves=flatten(intcrv.Curve),
    NodeSize=series,
    SizePoints=divide_2.Points,
    EndOffset=Slider(3, range=0..10),
    StrutSize=1,
    Segment=0,
    KinkAngle=0.6,
    CubeFit=0,
    Caps=1)
preview = CustomPreview(
    Geometry=mp,
    Material={diffuse=RGB(221, 160, 221), emission=RGB(66, 48, 66), shine=0.5, specular=RGB(255, 255, 255), transparency=0})

# ---- group: Open Ends
lng = ListLength(List=cir)
item_2 = ListItem(List=cir, Index=0, Wrap=True)
item_3 = ListItem(List=cir, Index=expr("x-1", lng), Wrap=True)
merge = Merge(Data1=item_2, Data2=intcrv.Curve, Data3=item_3)  # -> simplify(Result)
