# Grasshopper definition Voronoi2D.gh (Grasshopper 1.0.7)

crv = Curve(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)
pop2d = Populate2D(Region={Plane=PlaneXY(0, 0, 0), Size=Domain2(u=0..20, v=0..10)}, Count=Slider(27, range=0..100), Seed=1)
boundary = BoundarySurfaces(Edges=crv)
voronoi = Voronoi(Points=pop2d, Radius=Slider(3, range=0..10), BruteForceOverride=False)
offset = OffsetCurve(Curve=crv, Distance=Slider(-1.2, range=-4.2..5.2), Corners=1)
popgeo = PopulateGeometry(Geometry=boundary, Count=Slider(50, range=0..1000), Seed=1)
scale = Scale(Geometry=voronoi, Center=pop2d, Factor=0.5)  # -> Geometry, Transform
series = Series(Start=0, Step=1, Count=10)
voronoi_2 = Voronoi(Points=popgeo, Radius=Slider(4, range=0..10), BruteForceOverride=False)
boundary_2 = BoundarySurfaces(Edges=[scale.Geometry, voronoi])
Z = UnitZ(Factor=series)
extr = Extrude(Base=boundary_2, Direction=Z)
scale_2 = Scale(Geometry=voronoi_2, Center=popgeo, Factor=Slider(0.8, range=0..1))  # -> Geometry, Transform
preview = CustomPreview(
    Geometry=extr,
    Material={diffuse=RGB(221, 160, 221), emission=RGB(66, 48, 66), shine=0.5, specular=RGB(255, 255, 255), transparency=0})
rint = RegionIntersection(CurvesA=offset, CurvesB=graft(scale_2.Geometry))
boundary_3 = BoundarySurfaces(Edges=flatten([crv, rint]))
Z_2 = UnitZ(Factor=1)
extr_2 = Extrude(Base=boundary_3, Direction=Z_2)
preview_2 = CustomPreview(
    Geometry=extr_2,
    Material={diffuse=RGB(221, 160, 221), emission=RGB(66, 48, 66), shine=0.5, specular=RGB(255, 255, 255), transparency=0})
