# Grasshopper definition Voronoi3D.gh (Grasshopper 1.0.7)

# ---- group: Box
box = Box({Plane=PlaneXY(-13, -9, 4), X=Domain(0, 9), Y=Domain(0, 15), Z=Domain(0, 11)})
pop3d = Populate3D(Region=box, Count=Slider(20, range=0..100), Seed=1)
voronoi³ = Voronoi3D(Points=pop3d, Box=box)  # -> Cells, Boundary
volume = Volume(Geometry=box)  # -> Volume, Centroid
volume_2 = Volume(Geometry=voronoi³.Cells)  # -> Volume, Centroid
scale = Scale(Geometry=box, Center=volume.Centroid, Factor=Slider(0.95, range=0..1))  # -> Geometry, Transform
scale_2 = Scale(Geometry=voronoi³.Cells, Center=volume_2.Centroid, Factor=Slider(0.9, range=0..1))  # -> Geometry, Transform
sdiff = SolidDifference(BrepsA=scale_2.Geometry, BrepsB=scale.Geometry)
preview = CustomPreview(
    Geometry=sdiff,
    Material={diffuse=RGB(221, 160, 221), emission=RGB(66, 48, 66), shine=0.5, specular=RGB(255, 255, 255), transparency=0})

# ---- group: Custom BRep
brep = Brep(<brep referenced from the Rhino model>)
pop3d_2 = Populate3D(Region=brep, Count=Slider(100, range=0..100), Seed=1)
voronoi³_2 = Voronoi3D(Points=pop3d_2)  # -> Cells, Boundary
volume_3 = Volume(Geometry=brep)  # -> Volume, Centroid
volume_4 = Volume(Geometry=voronoi³_2.Cells)  # -> Volume, Centroid
scale_3 = Scale(Geometry=brep, Center=volume_3.Centroid, Factor=Slider(0.95, range=0..1))  # -> Geometry, Transform
scale_4 = Scale(Geometry=voronoi³_2.Cells, Center=volume_4.Centroid, Factor=Slider(0.9, range=0..1))  # -> Geometry, Transform
sdiff_2 = SolidDifference(BrepsA=scale_4.Geometry, BrepsB=scale_3.Geometry)
preview_2 = CustomPreview(
    Geometry=sdiff_2,
    Material={diffuse=RGB(221, 160, 221), emission=RGB(66, 48, 66), shine=0.5, specular=RGB(255, 255, 255), transparency=0})
