# Grasshopper definition Voronoi_morpfSrf.gh (Grasshopper 1.0.7)
# plug-ins: Kangaroo2 Components, LunchBox

srf = Surface(<surface referenced from the Rhino model>)
unroll = UnrollBrep(Brep=srf, JoinUnrolled=False)
popgeo = PopulateGeometry(Geometry=unroll, Count=Slider(41, range=0..100), Seed=1)
voronoi = Voronoi(Points=flatten(popgeo), Radius=Slider(15, range=0..210), BruteForceOverride=False)
mp = MultiPipe(Curves=voronoi, NodeSize=Slider(2, range=0..10), EndOffset=1, StrutSize=1, Segment=0, KinkAngle=0.6, CubeFit=0, Caps=0)
dom = ConstructDomain(DomainStart=0, DomainEnd=Slider(113, range=0..138))
dom_2 = ConstructDomain(DomainStart=0, DomainEnd=Slider(57, range=0..100))
dom_3 = ConstructDomain(DomainStart=0, DomainEnd=Slider(2, range=0..10))
srfmorph = SurfaceMorph(
    Geometry=mp,
    Reference={Plane=Plane(origin=(0, 57, 0), x=(1, 0, 0), y=(0, -1, 0)), X=Domain(0, 138), Y=Domain(0, 57), Z=Domain(-2, 0)},
    Surface=srf,
    UDomain=dom,
    VDomain=dom_2,
    WDomain=dom_3)
preview = CustomPreview(
    Geometry=srfmorph,
    Material={diffuse=RGB(221, 160, 221), emission=RGB(66, 48, 66), shine=0.5, specular=RGB(255, 255, 255), transparency=0})
