# Grasshopper definition imageMapper.gh (Grasshopper 1.0.7)

number_slider = Slider(100, range=0..1000)
crv = Curve(<curve referenced from the Rhino model>)
boundary = BoundarySurfaces(Edges=crv)
sdivide = DivideSurface(Surface=reparameterize(boundary), UCount=number_slider, VCount=number_slider)  # -> Points, Normals, Parameters
image = ImageSampler(
    sdivide.Parameters,
    FilePath="C:\Users\ICPC-NB-XX\Downloads\terrainNoise.PNG",
    Filter="Colour",
    Interpolate=False,
    Umax=1,
    Umin=0,
    Vmax=1,
    Vmin=0,
    Wrap=1)
multiplication = Multiplication(A=image, B=Slider(1, range=0..10))
panel = Panel(image)
amp = Amplitude(Vector=sdivide.Normals, Amplitude=multiplication)
move = Move(Geometry=sdivide.Points, Motion=amp)  # -> simplify(Geometry), Transform
srfgrid = SurfaceFromPoints(Points=flatten(move.Geometry), UCount=expr("x+1", number_slider), Interpolate=False)
preview = CustomPreview(
    Geometry=srfgrid,
    Material={diffuse=RGB(221, 160, 221), emission=RGB(66, 48, 66), shine=0.5, specular=RGB(255, 255, 255), transparency=0})
