# Grasshopper definition sinusoidShatterMultipipeGradient.gh (Grasshopper 1.0.7)
# plug-ins: Kangaroo2 Components

length = Slider(16, range=0..100)
amplitude = Slider(10, range=0..10)
series = Series(Start=0, Step=Slider(18.069, range=0..30), Count=length)
pop2d = Populate2D(Region={Plane=PlaneXY(0, 0, 0), Size=Domain2(u=0..20, v=0..10)}, Count=Slider(27, range=0..100), Seed=1)  # disabled
sin = Sine(Value=series)
voronoi = Voronoi(Points=pop2d, Radius=Slider(3, range=0..10), BruteForceOverride=False)
pt = ConstructPoint(XCoordinate=0, YCoordinate=series, ZCoordinate=0)
multiplication = Multiplication(A=sin, B=amplitude)
scale = Scale(Geometry=voronoi, Center=pop2d, Factor=0.5)  # -> Geometry, Transform
pt_2 = ConstructPoint(XCoordinate=pt, YCoordinate=multiplication, ZCoordinate=0)
series_2 = Series(Start=0, Step=1, Count=10)
Z = UnitZ(Factor=Slider(30, range=0..30))
boundary = BoundarySurfaces(Edges=[scale.Geometry, voronoi])
intcrv = Interpolate(Vertices=pt_2, Degree=3, Periodic=False, KnotStyle=1)  # -> Curve, Length, Domain
Z_2 = UnitZ(Factor=series_2)
extr = Extrude(Base=boundary, Direction=Z_2)
preview = CustomPreview(
    Geometry=extr,
    Material={diffuse=RGB(221, 160, 221), emission=RGB(66, 48, 66), shine=0.5, specular=RGB(255, 255, 255), transparency=0})
divide = DivideCurve(Curve=intcrv.Curve, Count=10, Kinks=False)  # -> Points, Tangents, Parameters
shatter = Shatter(Curve=intcrv.Curve, Parameters=divide.Parameters)
move = Move(Geometry=divide.Points, Motion=Z)  # -> Geometry, Transform
ln = Line(StartPoint=move.Geometry, EndPoint=divide.Points)
shatter_2 = Shatter(Curve=intcrv.Curve, Parameters=divide.Parameters)
series_3 = Series(Start=1, Step=1, Count=Slider(26, range=0..100))
move_2 = Move(Geometry=shatter_2, Motion=Z)  # -> Geometry, Transform
merge = Merge(Data1=shatter, Data2=move_2.Geometry, Data3=ln)  # -> flatten(Result)
mp = MultiPipe(
    Curves=merge,
    NodeSize=series_3,
    SizePoints=divide.Points,
    EndOffset=1,
    StrutSize=1,
    Segment=0,
    KinkAngle=0.6,
    CubeFit=0,
    Caps=1)
preview_2 = CustomPreview(
    Geometry=mp,
    Material={diffuse=RGB(221, 160, 221), emission=RGB(66, 48, 66), shine=0.5, specular=RGB(255, 255, 255), transparency=0})
