# Grasshopper definition surfaceUVfunc.gh (Grasshopper 1.0.7)
# plug-ins: Noise

crv = Curve(<curve referenced from the Rhino model>)  # disabled
divide = DivideCurve(Curve=crv, Count=Slider(43, range=0..100), Kinks=False)  # -> Points, Tangents, Parameters
pdecon = Deconstruct(Point=divide.Points)  # -> XComponent, YComponent, ZComponent
bnd = Bounds(Numbers=pdecon.XComponent)
remap = RemapNumbers(Value=pdecon.XComponent, Source=bnd, Target=Domain(0, 1))  # -> Mapped, Clipped
graph = GraphMapper(
    remap.Mapped,
    x0=0,
    x1=1,
    y0=0,
    y1=1,
    container_name="Sinc",
    Equation_X0=0.803188622,
    Equation_X1=1,
    Equation_Y0=0.6753622293,
    Equation_Y1=0.3550724387)
multiplication = Multiplication(A=graph, B=Slider(61, range=0..130))
pt = ConstructPoint(XCoordinate=pdecon.XComponent, YCoordinate=pdecon.YComponent, ZCoordinate=multiplication)
sn = SimplexNoise(Points=pt, Size=Slider(31, range=0..210), Seed=0, T=1)
multiplication_2 = Multiplication(A=Slider(14, range=0..210), B=sn)
Z = UnitZ(Factor=multiplication_2)
move = Move(Geometry=pt, Motion=Z)  # -> Geometry, Transform
intcrv = Interpolate(Vertices=pt, Degree=3, Periodic=False, KnotStyle=1)  # -> Curve, Length, Domain
intcrv_2 = Interpolate(Vertices=move.Geometry, Degree=3, Periodic=False, KnotStyle=1)  # -> Curve, Length, Domain

crv_2 = Curve(<curve referenced from the Rhino model>)
divide_2 = DivideCurve(Curve=crv_2, Count=Slider(43, range=0..100), Kinks=False)  # -> Points, Tangents, Parameters
pdecon_2 = Deconstruct(Point=divide_2.Points)  # -> XComponent, YComponent, ZComponent
bnd_2 = Bounds(Numbers=pdecon_2.XComponent)
remap_2 = RemapNumbers(Value=pdecon_2.XComponent, Source=bnd_2, Target=Domain(0, 1))  # -> Mapped, Clipped
graph_2 = GraphMapper(
    remap_2.Mapped,
    x0=0,
    x1=1,
    y0=0,
    y1=1,
    container_name="Sinc",
    Equation_X0=0.4531112909,
    Equation_X1=0.9450122118,
    Equation_Y0=0.2936923504,
    Equation_Y1=0.7681168318)
series = Series(Start=0, Step=Slider(20, range=0..100), Count=10)
multiplication_3 = Multiplication(A=graph_2, B=Slider(61, range=0..130))
Y = UnitY(Factor=series)
pt_2 = ConstructPoint(XCoordinate=pdecon_2.XComponent, YCoordinate=pdecon_2.YComponent, ZCoordinate=multiplication_3)
move_2 = Move(Geometry=graft(pt_2), Motion=Y)  # -> Geometry, Transform
lng = ListLength(List=move_2.Geometry)
range = Range(Domain=Domain(0, 1), Steps=expr("x-1", lng))
graph_3 = GraphMapper(
    range,
    x0=0,
    x1=1,
    y0=0,
    y1=1,
    container_name="Sinc",
    Equation_X0=0.5537780523,
    Equation_X1=0.8371114135,
    Equation_Y0=0.8853518963,
    Equation_Y1=0.4112677574)
multiplication_4 = Multiplication(A=graph_3, B=Slider(20, range=0..130))
Z_2 = UnitZ(Factor=multiplication_4)
move_3 = Move(Geometry=move_2.Geometry, Motion=Z_2)  # -> Geometry, Transform
flip = FlipMatrix(Data=move_3.Geometry)
intcrv_3 = Interpolate(Vertices=move_3.Geometry, Degree=3, Periodic=False, KnotStyle=1)  # -> flatten(Curve), Length, Domain
intcrv_4 = Interpolate(Vertices=flip, Degree=3, Periodic=False, KnotStyle=1)  # -> flatten(Curve), Length, Domain
srfgrid = SurfaceFromPoints(Interpolate=False)
netsurf = NetworkSurface(CurvesU=intcrv_4.Curve, CurvesV=intcrv_3.Curve, Continuity=2)
preview = CustomPreview(
    Geometry=netsurf,
    Material={diffuse=RGB(221, 160, 221), emission=RGB(66, 48, 66), shine=0.5, specular=RGB(255, 255, 255), transparency=0})
